# Grasshopper definition Rhino_File_Generator_10122022.gh (Grasshopper 1.0.7)

python = GhPythonScript()  # -> gh_file_path
# ---------- python: Python ----------
__author__ = "Xiaoshi"
__version__ = "2022.01.02"

import rhinoscriptsyntax as rs
gh_file_path = ghenv.Component.OnPingDocument().FilePath
# ---------- end python ----------
python_2 = GhPythonScript(gh_file_path=python)  # -> rm
# ---------- python_2: Python ----------
__author__ = "Xiaoshi"
__version__ = "2022.01.02"

import rhinoscriptsyntax as rs
rm = gh_file_path.replace("Rhino_File_Generator_10122022.gh","room_temp.csv")
# ---------- end python_2 ----------
python_3 = GhPythonScript(gh_file_path=python)  # -> op_in
# ---------- python_3: Python ----------
__author__ = "Xiaoshi"
__version__ = "2022.01.02"

import rhinoscriptsyntax as rs
op_in = gh_file_path.replace("Rhino_File_Generator_10122022.gh","opening_temp.csv")
# ---------- end python_3 ----------
timer = Timer(Interval=50, TimerInterval=50, Target=[file, file_2, c_script_4, python_5])
file = ReadFile(File=python_2, PerLineParse=True)
file_2 = ReadFile(File=python_3, PerLineParse=True)
split = TextSplit(Text=file, Separators=",")  # -> simplify(Result)
split_2 = TextSplit(Text=file_2, Separators=",")  # -> simplify(Result)
c_script = CSharpScript(b=split_2)  # -> out, flatten(rec); inputs b: list of Double
# ---------- c_script: C# ----------
    double eps = 0.000001;
    Rectangle3d r;
    if(Math.Abs(b[0] - b[1]) < eps){
      Point3d origin = new Point3d(b[0], 0.0, 0.0);
      Plane p = new Plane(origin, Vector3d.YAxis, Vector3d.ZAxis);
      Interval domain_y = new Interval(b[2], b[3]);
      Interval domain_z = new Interval(b[4], b[5]);
      r = new Rectangle3d(p, domain_y, domain_z);
    }
    else if(Math.Abs(b[2] - b[3]) < eps){
      Point3d origin = new Point3d(0.0, b[2], 0.0);
      Plane p = new Plane(origin, Vector3d.XAxis, Vector3d.ZAxis);
      Interval domain_x = new Interval(b[0], b[1]);
      Interval domain_z = new Interval(b[4], b[5]);
      r = new Rectangle3d(p, domain_x, domain_z);
    }
    else{
      Point3d origin = new Point3d(0.0, 0.0, b[4]);
      Plane p = new Plane(origin, Vector3d.XAxis, Vector3d.YAxis);
      Interval domain_x = new Interval(b[0], b[1]);
      Interval domain_y = new Interval(b[2], b[3]);
      r = new Rectangle3d(p, domain_x, domain_y);
    }
    rec = r;
# ---------- end c_script ----------
c_script_2 = CSharpScript(data_tree=split)  # -> out, Rooms, num_iter; inputs data_tree: tree of Double
# ---------- c_script_2: C# ----------
    List<Box> rms = new List<Box>();
    for (int i = 0; i < data_tree.BranchCount-1; i++){
      List<double> domain = data_tree.Branch(i);
      Interval x = new Interval(domain[0], domain[1]);
      Interval y = new Interval(domain[2], domain[3]);
      Interval z = new Interval(domain[4], domain[5]);
      Box rm = new Box(Plane.WorldXY, x, y, z);
      rms.Add(rm);
    }
    Rooms = rms;
    num_iter = data_tree.Branch(data_tree.BranchCount - 1);
# ---------- end c_script_2 ----------
boundary = BoundarySurfaces(Edges=c_script.rec)
preview = CustomPreview(Geometry=boundary, Material=ColourSwatch(SwatchColor=RGB(255, 255, 255)))
flip = Flip(Surface=boundary)  # -> Surface, Result
debrep = DeconstructBrep(Brep=c_script_2.Rooms)  # -> Faces, Edges, Vertices
srf = Surface([boundary, flip.Surface])
c_script_3 = CSharpScript(walls=debrep.Faces, wins=srf)  # -> out, simplify(A); inputs walls: tree of Brep, wins: list of Brep
# ---------- c_script_3: C# ----------
    DataTree<Brep> new_walls = walls;
    int num_room = walls.BranchCount;
    Brep[] new_wall;

    for(int i = 0; i < wins.Count; i++){
      for(int j = 0; j < num_room; j++){
        for(int k = 0; k < new_walls.Branch(j).Count; k++){
          Vector3d wa = new_walls.Branch(j)[k].Faces[0].NormalAt(0.0, 0.0);
          Vector3d wi = wins[i].Faces[0].NormalAt(0.0, 0.0);
          if(wa.IsParallelTo(wi) == 1){
            new_wall = Brep.CreateBooleanDifference(new_walls.Branch(j)[k], wins[i], 0.001);
            if(new_wall == null){
              break;
            }
            if(new_wall.Length > 0){
              //Print("j: " + j.ToString());
              new_walls.Branch(j).RemoveAt(k);
              for(int m = 0; m < new_wall.Length; m++){
                new_walls.Branch(j).Add(new_wall[m]);
              }
              break;
            }
          }
        }
      }
    }
    A = new_walls;
# ---------- end c_script_3 ----------
join = BrepJoin(Breps=c_script_3.A)  # -> flatten(Breps), Closed
brep = Brep(join.Breps)

expression = Expression(x="100.0", y="15.0", Expression="x/2-y")
bbox = BoundingBox(Content=brep, Plane=PlaneXY(0, 0, 0), UnionBox=True)  # -> Box, Box_2
expression_2 = Expression(x="12.0", Expression="x/2")
box = EvaluateBox(Box=bbox.Box, UParameter="0.0", VParameter="0.5", WParameter="0.0")  # -> Plane, Point, Include
vec = VectorXYZ(XComponent=expression, YComponent=0, ZComponent=expression_2)  # -> Vector, Length
expression_3 = Expression(x="100.0", Expression="x/2")
expression_4 = Expression(x="50.0", Expression="x/2")
panel = Panel(expression_2)
move = Move(Geometry=box.Plane, Motion=vec.Vector)  # -> Geometry, Transform
box_2 = CenterBox(Base=move.Geometry, X=expression_3, Y=expression_4, Z=panel)

brep_2 = Brep([brep, box_2])
python_4 = GhPythonScript(num_iter=c_script_2.num_iter, gh_file_path=python, target_path="E:\00_Data_Generator")  # -> rhino_folder, flag_file; inputs num_iter: Int32
# ---------- python_4: Python ----------
__author__ = "Xiaoshi"
__version__ = "2022.01.02"

import rhinoscriptsyntax as rs
rhino_folder = target_path + "\CFD_result_data\design_iteration_"+str(num_iter)+"\\"
flag_file = gh_file_path.replace("Rhino_File_Generator_10122022.gh","GH_active_flag.txt")
# ---------- end python_4 ----------
toggle = BooleanToggle(True)
panel_2 = Panel(brep_2)
c_script_4 = CSharpScript(num_iter=c_script_2.num_iter, geom=brep_2, path=python_4.rhino_folder, activate=toggle)  # inputs num_iter: Int32, geom: list of Brep, path: String, activate: Boolean
# ---------- c_script_4: C# ----------
    if(activate){
      if(old_iter != num_iter){

        var file = new Rhino.FileIO.File3dm();
        file.Settings.ModelUnitSystem = UnitSystem.Meters;
        for (int i = 0; i < geom.Count; i++){
          file.Objects.AddBrep(geom[i]);
        }

        path = path + "design_iteration_" + num_iter + ".3dm";
        file.Write(path, 6);
        old_iter = num_iter;
      }
    }
# ---------- c_script_4: C# additional code ----------
  int old_iter = -1;
# ---------- end c_script_4 ----------
python_5 = GhPythonScript(flag_file=python_4.flag_file, activate=toggle)  # inputs activate: Boolean
# ---------- python_5: Python ----------
__author__ = "Xiaoshi"
__version__ = "2022.02.07"

import rhinoscriptsyntax as rs
if activate:
    file = open(flag_file,'r+')
    num = int(file.read())
    print(num)
    if num < 20:
        file.truncate(0)
        file.write(str(num+1))
    else:
        file.truncate(0)
        file.write(str(0))
    file.close()
# ---------- end python_5 ----------
