# Grasshopper definition OILR_GH_Tooling_Wind_Driven_0410.gh (Grasshopper 1.0.7)

# ----
# Define External Boundary
ext_xdim = Slider(59, range=32..80, expression="x*0.25")
ext_ydim = Slider(63, range=32..80, expression="x*0.25")
panel = Panel(ext_ydim)
panel_2 = Panel(ext_xdim)

# ----
# Create 2 Rooms by Spliting
# the External Boundary
cut_pos = Slider(0.43, range=0..1)
cut_across_axis = ValueList({"Split X": "x", "Split Y": "y"}, selected="Split Y")
panel_3 = Panel(cut_across_axis)
panel_4 = Panel(cut_pos)

# ----
# Create the 3rd Room by Spliting
# One Existing Room
cut_pos_2 = Slider(0.39, range=0..1)
cut_across_axis_2 = ValueList({"Split X": "x", "Split Y": "y"}, selected="Split X")
rm_to_cut = ValueList({"#0": 0, "#1": 1}, selected="#0")
panel_5 = Panel(cut_across_axis_2)
panel_6 = Panel(cut_pos_2)

# ----
# Create the 5th Room by Spliting
# One Existing Room
cut_pos_3 = Slider(0.52, range=0..1)
cut_across_axis_3 = ValueList({"Split X": "x", "Split Y": "y"}, selected="Split Y")
rm_to_cut_2 = ValueList({"#0": 0, "#1": 1, "#2": 2, "#3": 3}, selected="#1")
panel_7 = Panel(cut_across_axis_3)
panel_8 = Panel(cut_pos_3)

# ----
# Create the 4th Room by Spliting
# One Existing Room
cut_pos_4 = Slider(0.64, range=0..1)
cut_across_axis_4 = ValueList({"Split X": "x", "Split Y": "y"}, selected="Split X")
rm_to_cut_3 = ValueList({"#0": 0, "#1": 1, "#2": 2}, selected="#1")
panel_9 = Panel(cut_across_axis_4)
panel_10 = Panel(cut_pos_4)

# ----
# Create Rooms
# (Box Spliting Method)
define_room = ValueList({"Define ext dimension": 0, "Create the 2nd room": 1, "Create the 3rd room": 2, "Create the 4th room": 3, "Create the 5th room": 4}, selected="Create the 5th room")
define_rooms = Define_Rooms(
    int=define_room,
    ext_xdim=panel_2,
    ext_ydim=panel,
    split_dim=panel_3,
    cut_pos=panel_4,
    sel_index=rm_to_cut,
    split_dim_2=panel_5,
    cut_pos_2=panel_6,
    sel_index_2=rm_to_cut_3,
    split_dim_3=panel_9,
    cut_pos_3=panel_10,
    sel_index_3=rm_to_cut_2,
    split_dim_4=panel_7,
    cut_pos_4=panel_8)

update_geometry = Button()
index_of_wall = ValueList({"None": -1, "wall #0": 0, "wall #1": 1, "wall #2": 2, "wall #3": 3, "wall #4": 4, "wall #5": 5, "wall #6": 6, "wall #7": 7, "wall #8": 8, "wall #9": 9, "wall #10": 10, "wall #11": 11, "wall #12": 12, "wall #13": 13, "wall #14": 14, "wall #15": 15, "wall #16": 16, "wall #17": 17, "wall #18": 18, "wall #19": 19, "wall #20": 20, "wall #21": 21}, selected="wall #3")
opening_type = ValueList({"None": 0, "window": 1, "high window": 2, "door": 3, "passage": 4}, selected="window")
width = Slider(7, range=0..30, expression="x*0.25")
height = Slider(5, range=0..12, expression="x*0.25")
h_pos = Slider(6, range=0..36, expression="x*0.25")
v_pos = Slider(5, range=0..10, expression="x*0.25")
panel_11 = Panel(index_of_wall)
panel_12 = Panel(width)
panel_13 = Panel(height)
panel_14 = Panel(h_pos)
panel_15 = Panel(v_pos)

# ----
# Room Data
num = Number(panel_2)
num_2 = Number(panel)
box = Box(define_rooms)

# ----
# Create Openings
load_latest_geometry = Button()
define_openings = CSharpScript(
    boxes=box,
    update=update_geometry,
    wall_id=panel_11,
    win_type=opening_type,
    width=panel_12,
    height=panel_13,
    h_pos=panel_14,
    v_pos=panel_15,
    load=load_latest_geometry)  # -> cur_window, flatten(all_ind), flatten(all_window); inputs boxes: list of Brep, update: Boolean, wall_id: Int32, win_type: Int32, width: Double, height: Double, h_pos: Double, v_pos: Double, load: Boolean
# ---------- define_openings: C# usings ----------
using System.IO;
using System.Linq;
using System.Data;
using System.Drawing;
using System.Reflection;
using System.Windows.Forms;
using System.Xml;
using System.Xml.Linq;
using System.Runtime.InteropServices;

using Rhino.DocObjects;
using Rhino.Collections;
using GH_IO;
using GH_IO.Serialization;
# ---------- define_openings: C# ----------
    List<int> output_ind = new List<int>();
    List<Rectangle3d> output_rec = new List<Rectangle3d>();

    Brep[] bbrep = Brep.CreateBooleanUnion(boxes.ToArray(), 0.0001);
    Curve[] Ei = bbrep[0].DuplicateEdgeCurves();
    List<Rectangle3d> all_rec = new List<Rectangle3d>();
    for (int i = 0; i < Ei.Length; i++){
      if (Ei[i].PointAt(0.5).Z == 0.0){
        Line li = new Line(Ei[i].PointAtStart, Ei[i].PointAtEnd);
        if (li.FromX == li.ToX){
          Point3d pt_ori = new Point3d(li.FromX, (li.FromY + li.ToY) / 2.0, 1.5);
          Plane pl = new Plane(pt_ori, Vector3d.YAxis, Vector3d.ZAxis);
          Rectangle3d rec = new Rectangle3d(pl, new Interval(-li.Length / 2.0, li.Length / 2.0), new Interval(-1.5, 1.5));
          all_rec.Add(rec);
        }
        else{
          Point3d pt_ori = new Point3d((li.FromX + li.ToX) / 2.0, li.FromY, 1.5);
          Plane pl = new Plane(pt_ori, Vector3d.XAxis, Vector3d.ZAxis);
          Rectangle3d rec = new Rectangle3d(pl, new Interval(-li.Length / 2.0, li.Length / 2.0), new Interval(-1.5, 1.5));
          all_rec.Add(rec);
        }
      }
    }

    Rectangle3d face = all_rec[wall_id];

    double xl = face.X.Min + h_pos;
    double xh = Math.Min(xl + width, face.X.Max);
    double yl = face.Y.Min + v_pos;
    double yh = Math.Min(yl + height, face.Y.Max);

    if (win_type == 0){
      xl = 0.0;
      xh = 0.0;
      yl = 0.0;
      yh = 0.0;
    }
    else if (win_type == 1){
      yl = Math.Min(yl, face.Y.Min + 1.0);
      yh = Math.Min(yl + height, face.Y.Max);
    }
    else if (win_type == 2){
      yl = Math.Max(yl, face.Y.Min + 2.25);
      yl = Math.Min(yl, face.Y.Min + 2.5);
      yh = face.Y.Max;
    }
    else if (win_type == 3){
      xl = Math.Min(xl, face.X.Max - 1.0);
      xh = xl + 1.0;
      yl = face.Y.Min;
      yh = face.Y.Min + 2.0;
    }
    else if(win_type == 4){
      xl = Math.Min(xl, face.X.Max - 1.0);
      xh = Math.Max(xh, xl + 1.0);
      xh = Math.Min(xh, xl + 2.0);
      xh = Math.Min(xh, face.X.Max);
      yl = face.Y.Min;
      yh = face.Y.Max;
    }
    //Print(Convert.ToString(yl));
    //Print(Convert.ToString(yh));
    Rectangle3d win_surf = new Rectangle3d(face.Plane, new Interval(xl, xh), new Interval(yl, yh));
    if (update){
      new_rec[wall_id] = win_surf;
      //GH_Document gh_d = owner.OnPingDocument();
      //string op_pth = gh_d.FilePath.Replace("OILR_GH_Tooling_0410.gh", "opening_temp_1.csv");
      //var csv = new StringBuilder();
      //File.WriteAllText(op_pth, csv.ToString());
    }

    if (load){
      GH_Document gh_d = owner.OnPingDocument();
      string op_pth = gh_d.FilePath.Replace("OILR_GH_Tooling_Wind_Driven_0410.gh", "opening_temp.csv");
      string wid_pth = gh_d.FilePath.Replace("OILR_GH_Tooling_Wind_Driven_0410.gh", "winid_temp.csv");
      var op_lines = File.ReadAllLines(op_pth);
      var inds = File.ReadAllLines(wid_pth);

      for (int i = 0; i < op_lines.Length; i++){
        // for (int i = 0; i < 1; i++){
        string[] param = op_lines[i].Split(',');
        int op_ind = Convert.ToInt32(inds[0].Split(',')[i]);
        Rectangle3d f = all_rec[op_ind];
        if (param[0] == param[1]){
          double dim1_l = Convert.ToDouble(param[2]) - f.Plane.OriginY;
          double dim1_h = Convert.ToDouble(param[3]) - f.Plane.OriginY;
          double dim2_l = Convert.ToDouble(param[4]) - f.Plane.OriginZ;
          double dim2_h = Convert.ToDouble(param[5]) - f.Plane.OriginZ;
          Rectangle3d win_sf = new Rectangle3d(f.Plane, new Interval(dim1_l, dim1_h), new Interval(dim2_l, dim2_h));
          new_rec[op_ind] = win_sf;
        }
        else if (param[2] == param[3]){
          double dim1_l = Convert.ToDouble(param[0]) - f.Plane.OriginX;
          double dim1_h = Convert.ToDouble(param[1]) - f.Plane.OriginX;
          double dim2_l = Convert.ToDouble(param[4]) - f.Plane.OriginZ;
          double dim2_h = Convert.ToDouble(param[5]) - f.Plane.OriginZ;
          Rectangle3d win_sf = new Rectangle3d(f.Plane, new Interval(dim1_l, dim1_h), new Interval(dim2_l, dim2_h));
          new_rec[op_ind] = win_sf;
        }
        else {
          double dim1_l = Convert.ToDouble(param[0]) - f.Plane.OriginX;
          double dim1_h = Convert.ToDouble(param[1]) - f.Plane.OriginX;
          double dim2_l = Convert.ToDouble(param[2]) - f.Plane.OriginY;
          double dim2_h = Convert.ToDouble(param[3]) - f.Plane.OriginY;
          Rectangle3d win_sf = new Rectangle3d(f.Plane, new Interval(dim1_l, dim1_h), new Interval(dim2_l, dim2_h));
          new_rec[op_ind] = win_sf;
        }
      }
    }

    for (int i = 0; i < new_rec.Length; i++){
      if (new_rec[i].Area > 0.0){
        output_ind.Add(i);
        output_rec.Add(new_rec[i]);
      }
    }

    cur_window = win_surf;
    all_ind = output_ind;
    all_window = output_rec;
# ---------- define_openings: C# additional code ----------
  Rectangle3d[] new_rec = new Rectangle3d[20];
# ---------- end define_openings ----------
wall_ind = Panel(define_openings.all_ind)

# ----
# Display Geometry Options
swatch = ColourSwatch(SwatchColor=RGB(255, 255, 0))
show_optimal = BooleanToggle(False)
int = Integer(wall_ind)
rec = Rectangle(define_openings.all_window)
preview = CustomPreview(Geometry=define_openings.cur_window, Material=swatch)
show_window = BooleanToggle(True)
python = GhPythonScript(rec_design=rec, show_optimal=show_optimal)  # -> recs; inputs rec_design: list of Rectangle3d, show_optimal: Boolean
# ---------- python: Python ----------
__author__ = "Xiaoshi"
__version__ = "2023.02.01"

import rhinoscriptsyntax as rs
import Rhino.Geometry as rg
import csv

if show_optimal:
    gh_file_path = ghenv.Component.OnPingDocument().FilePath
    op_path = gh_file_path.replace("OILR_GH_Tooling_Wind_Driven_0410.gh","opening_optimal.csv")
    rec_list = []
    with open(op_path) as csvfile:
        reader = csv.reader(csvfile, delimiter=',')
        for row in reader:
            xl, xh, yl, yh, zl, zh = float(row[0]), float(row[1]), float(row[2]), float(row[3]), float(row[4]), float(row[5])
            if xl==xh:
                pl = rg.Plane(rg.Point3d(xl, yl, zl), rg.Vector3d(0,1,0), rg.Vector3d(0,0,1))
                rec = rg.Rectangle3d(pl, yh-yl, zh-zl)
                rec_list.append(rec)
            elif yl==yh:
                pl = rg.Plane(rg.Point3d(xl, yl, zl), rg.Vector3d(1,0,0), rg.Vector3d(0,0,1))
                rec = rg.Rectangle3d(pl, xh-xl, zh-zl)
                rec_list.append(rec)
            else:
                pl = rg.Plane(rg.Point3d(xl, yl, zl), rg.Vector3d(1,0,0), rg.Vector3d(0,1,0))
                rec = rg.Rectangle3d(pl, xh-xl, yh-yl)
                rec_list.append(rec)
    recs = rec_list
else:
    recs = rec_design
# ---------- end python ----------
hide_roof = BooleanToggle(True)
display_geometry = Display_Geometry(box=box, sel_id=int, recs=python, hide_roof=hide_roof, show=show_window)

run_optimization = Button()

# ----
# Predict 3D Airflow Field
# (Using OILR Framework Model)
elevation = Slider(6, range=0..12, expression="x*0.25")
run_simulation = Button()
flow_metric = ValueList({"u (x velocity)": "result_u", "v (y velocity)": "result_v", "w (z velocity)": "result_w", "p (pressure)": "result_p"}, selected="u (x velocity)")
pth = CSharpScript()  # -> Local_folder
# ---------- pth: C# ----------
    GH_Document gh_d = owner.OnPingDocument();
    string wid_pth = gh_d.FilePath.Replace("OILR_GH_Tooling_Wind_Driven_0410.gh", "");
    Local_folder = wid_pth;
# ---------- end pth ----------
panel_16 = Panel(elevation)
simulator = GhPythonScript(run_sim=run_simulation, run_opt=run_optimization, folder=pth)  # inputs run_sim: Boolean
# ---------- simulator: Python ----------
__author__ = "Xiaoshi"
__version__ = "2023.02.20"

import os
import rhinoscriptsyntax as rs
import runpy
import subprocess

if run_sim:
    sim_exe_file = folder + "dist/Combined_Multizone_Predictor_0801.exe"
    shell_process = subprocess.Popen([sim_exe_file])
if run_opt:
    opt_exe_file = folder + "dist/Window_Optimization_0801.exe"
    shell_process = subprocess.Popen([opt_exe_file])
# ---------- end simulator ----------
display_airflow_field = Display_Airflow_Field(folder=pth, ext_xdim=num, ext_ydim=num_2, elevation=panel_16, uvwp=flow_metric)

save_geometry = GhPythonScript(ext_xdim=num, ext_ydim=num_2, box_rms=box, win_ids=int, rec_wins=rec, update=update_geometry)  # inputs box_rms: list of Box, win_ids: list of Int32, rec_wins: list of Rectangle3d, update: Boolean
# ---------- save_geometry: Python ----------
__author__ = "Xiaoshi"
__version__ = "2023.02.01"

import rhinoscriptsyntax as rs
import Rhino.Geometry as rg
import csv

gh_file_path = ghenv.Component.OnPingDocument().FilePath
rm_path = gh_file_path.replace("OILR_GH_Tooling_Wind_Driven_0410.gh","room_temp.csv")
op_path = gh_file_path.replace("OILR_GH_Tooling_Wind_Driven_0410.gh","opening_temp.csv")
wid_path = gh_file_path.replace("OILR_GH_Tooling_Wind_Driven_0410.gh","winid_temp.csv")

if update:
    wx = rg.Interval(-1.0, 0.0)
    wy = rg.Interval(0.0, ext_ydim)
    wz = rg.Interval(0.0, 3.0)
    w_box = rg.Box(rg.Plane.WorldXY, wx, wy, wz)
    sx = rg.Interval(0.0, ext_xdim)
    sy = rg.Interval(-1.0, 0.0)
    sz = rg.Interval(0.0, 3.0)
    s_box = rg.Box(rg.Plane.WorldXY, sx, sy, sz)
    ex = rg.Interval(ext_xdim, ext_xdim + 1.0)
    ey = rg.Interval(0.0, ext_ydim)
    ez = rg.Interval(0.0, 3.0)
    e_box = rg.Box(rg.Plane.WorldXY, ex, ey, ez)
    nx = rg.Interval(0.0, ext_xdim)
    ny = rg.Interval(ext_ydim, ext_ydim + 1.0)
    nz = rg.Interval(0.0, 3.0)
    n_box = rg.Box(rg.Plane.WorldXY, nx, ny, nz)
    WSEN_boxes = [w_box, s_box, e_box, n_box]

    # box_rms = [x for _, x in sorted(zip(ind_list, box_rms))]
    with open(rm_path, "wb") as rm_file:
        csvwriter = csv.writer(rm_file,  delimiter=',')
        for box in box_rms:
            xl, xh, yl, yh, zl, zh = box.X.Min, box.X.Max, box.Y.Min, box.Y.Max, box.Z.Min, box.Z.Max
            csvwriter.writerow([xl, xh, yl, yh, zl, zh])
        csvwriter.writerow([10000])
    box_ext = WSEN_boxes+box_rms
    ind_ext = range(-4,5)
    with open(op_path, "wb") as op_file:
        csvwriter = csv.writer(op_file,  delimiter=',')
        for rec in rec_wins:
            center = rec.Center
            opbox = rg.Box(rec.BoundingBox)
            xl, xh, yl, yh, zl, zh = opbox.X.Min, opbox.X.Max, opbox.Y.Min, opbox.Y.Max, opbox.Z.Min, opbox.Z.Max
            two_rms = []
            for rm_id in ind_ext:
                if rg.Brep.IsPointInside(box_ext[rm_id+4].ToBrep(),center,0.01,False):
                    two_rms.append(rm_id)
            csvwriter.writerow([xl, xh, yl, yh, zl, zh, two_rms[0], two_rms[1]])
    with open(wid_path, "wb") as wid_file:
        csvwriter = csv.writer(wid_file,  delimiter=',')
        csvwriter.writerow(win_ids)
# ---------- end save_geometry ----------

# ==== cluster Define_Rooms
ext_xdim = ClusterInput()
ext_ydim = ClusterInput()
int = ClusterInput()
_1_room = CSharpScript(ext_xdim=ext_xdim, ext_ydim=ext_ydim)  # -> out, flatten(one_rm), flatten(indices); inputs ext_xdim: Double, ext_ydim: Double
# ---------- _1_room: C# ----------
    Interval x = new Interval(0.0, ext_xdim);
    Interval y = new Interval(0.0, ext_ydim);
    Interval z = new Interval(0.0, 3.0);
    one_rm = new Box(Plane.WorldXY, x, y, z);
    
    indices = new List<int>(){0};
# ---------- end _1_room ----------
int_2 = Integer(int)
split_dim = ClusterInput()
cut_pos = ClusterInput()
_2_rooms = CSharpScript(one_rm=_1_room.one_rm, split_dim=split_dim, cut_pos=cut_pos)  # -> out, flatten(two_rms), flatten(indices); inputs one_rm: Box, split_dim: String, cut_pos: Double
# ---------- _2_rooms: C# ----------
    double x_length = one_rm.X.Length;
    double y_length = one_rm.Y.Length;
    List<Box> box_list = new List<Box>();
    if (string.Equals(split_dim, "x")){
      double xlen_1 = Math.Round((x_length / 0.25) * cut_pos, 0) * 0.25;
      Interval x_1 = new Interval(0.0, xlen_1);
      Interval x_2 = new Interval(xlen_1, x_length);
      box_list.Add(new Box(Plane.WorldXY, x_1, one_rm.Y, one_rm.Z));
      box_list.Add(new Box(Plane.WorldXY, x_2, one_rm.Y, one_rm.Z));
    }
    if (string.Equals(split_dim, "y")){
      double ylen_1 = Math.Round((y_length / 0.25) * cut_pos, 0) * 0.25;
      Interval y_1 = new Interval(0.0, ylen_1);
      Interval y_2 = new Interval(ylen_1, y_length);
      box_list.Add(new Box(Plane.WorldXY, one_rm.X, y_1, one_rm.Z));
      box_list.Add(new Box(Plane.WorldXY, one_rm.X, y_2, one_rm.Z));
    }
    two_rms = box_list;
    indices = new List<int>(){0,1};
# ---------- end _2_rooms ----------
path_mapper = PathMapper(_1_room.one_rm, source="{0}", target="{0}")
path_mapper_2 = PathMapper(_1_room.indices, source="{0}", target="{0}")
sel_index = ClusterInput()
split_dim_2 = ClusterInput()
cut_pos_2 = ClusterInput()
path_mapper_3 = PathMapper(_2_rooms.indices, source="{0}", target="{1}")
path_mapper_4 = PathMapper(_2_rooms.two_rms, source="{0}", target="{1}")
_3_rooms = CSharpScript(two_rms=_2_rooms.two_rms, sel_index=sel_index, split_dim=split_dim_2, cut_pos=cut_pos_2)  # -> out, flatten(three_rms), flatten(indices); inputs two_rms: list of Box, sel_index: Int32, split_dim: String, cut_pos: Double
# ---------- _3_rooms: C# ----------
    double x_max = two_rms[0].X.Max;
    double y_max = two_rms[0].Y.Max;
    for (int i = 1; i < two_rms.Count; i++){
      if (two_rms[i].X.Max > x_max){
        x_max = two_rms[i].X.Max;
      }
      if (two_rms[i].Y.Max > y_max){
        y_max = two_rms[i].Y.Max;
      }
    }

    Box sel_box = two_rms[sel_index];
    int other_ind = 0 + 1 - sel_index;
    List < Box > box_list = new List<Box>(){two_rms[other_ind]};
    List < int > ind_list = new List<int>(){other_ind};

    double x_length = sel_box.X.Length;
    double y_length = sel_box.Y.Length;

    if (string.Equals(split_dim, "x")){
      double xlen_1 = Math.Round((x_length / 0.25) * cut_pos, 0) * 0.25;
      Interval x_1 = new Interval(sel_box.X.Min, sel_box.X.Min + xlen_1);
      Interval x_2 = new Interval(sel_box.X.Min + xlen_1, sel_box.X.Min + x_length);
      box_list.Add(new Box(Plane.WorldXY, x_1, sel_box.Y, sel_box.Z));
      ind_list.Add(sel_index);
      box_list.Add(new Box(Plane.WorldXY, x_2, sel_box.Y, sel_box.Z));
      ind_list.Add(2);
    }
    if (string.Equals(split_dim, "y")){
      double ylen_1 = Math.Round((y_length / 0.25) * cut_pos, 0) * 0.25;
      Interval y_1 = new Interval(sel_box.Y.Min, sel_box.Y.Min + ylen_1);
      Interval y_2 = new Interval(sel_box.Y.Min + ylen_1, sel_box.Y.Min + y_length);
      box_list.Add(new Box(Plane.WorldXY, sel_box.X, y_1, sel_box.Z));
      ind_list.Add(sel_index);
      box_list.Add(new Box(Plane.WorldXY, sel_box.X, y_2, sel_box.Z));
      ind_list.Add(2);
    }
    three_rms = box_list;
    indices = ind_list;
# ---------- end _3_rooms ----------
sel_index_2 = ClusterInput()
split_dim_3 = ClusterInput()
cut_pos_3 = ClusterInput()
path_mapper_5 = PathMapper(_3_rooms.three_rms, source="{0}", target="{2}")
path_mapper_6 = PathMapper(_3_rooms.indices, source="{0}", target="{2}")
_4_rooms = CSharpScript(
    three_rms=_3_rooms.three_rms,
    three_ind=_3_rooms.indices,
    sel_index=sel_index_2,
    split_dim=split_dim_3,
    cut_pos=cut_pos_3)  # -> out, flatten(four_rms), flatten(indices); inputs three_rms: list of Box, three_ind: list of Int32, sel_index: Int32, split_dim: String, cut_pos: Double
# ---------- _4_rooms: C# ----------
    double x_max = three_rms[0].X.Max;
    double y_max = three_rms[0].Y.Max;
    for (int i = 1; i < three_rms.Count; i++){
      if (three_rms[i].X.Max > x_max){
        x_max = three_rms[i].X.Max;
      }
      if (three_rms[i].Y.Max > y_max){
        y_max = three_rms[i].Y.Max;
      }
    }

    Box sel_box = new Box();
    List <Box> box_list = new List<Box>();
    List <Int32> ind_list = new List<Int32>();
    for (int i = 0; i < three_rms.Count;i++){
      if (three_ind[i] != sel_index){
        box_list.Add(three_rms[i]);
        ind_list.Add(three_ind[i]);
      }
      else{
        sel_box = three_rms[i];
      }
    }
    double x_length = sel_box.X.Length;
    double y_length = sel_box.Y.Length;

    if (string.Equals(split_dim, "x")){
      double xlen_1 = Math.Round((x_length / 0.25) * cut_pos, 0) * 0.25;
      Interval x_1 = new Interval(sel_box.X.Min, sel_box.X.Min + xlen_1);
      Interval x_2 = new Interval(sel_box.X.Min + xlen_1, sel_box.X.Min + x_length);
      box_list.Add(new Box(Plane.WorldXY, x_1, sel_box.Y, sel_box.Z));
      ind_list.Add(sel_index);
      box_list.Add(new Box(Plane.WorldXY, x_2, sel_box.Y, sel_box.Z));
      ind_list.Add(3);
    }
    if (string.Equals(split_dim, "y")){
      double ylen_1 = Math.Round((y_length / 0.25) * cut_pos, 0) * 0.25;
      Interval y_1 = new Interval(sel_box.Y.Min, sel_box.Y.Min + ylen_1);
      Interval y_2 = new Interval(sel_box.Y.Min + ylen_1, sel_box.Y.Min + y_length);
      box_list.Add(new Box(Plane.WorldXY, sel_box.X, y_1, sel_box.Z));
      ind_list.Add(sel_index);
      box_list.Add(new Box(Plane.WorldXY, sel_box.X, y_2, sel_box.Z));
      ind_list.Add(3);
    }
    four_rms = box_list;
    indices = ind_list;
# ---------- end _4_rooms ----------
sel_index_3 = ClusterInput()
split_dim_4 = ClusterInput()
cut_pos_4 = ClusterInput()
path_mapper_7 = PathMapper(_4_rooms.four_rms, source="{0}", target="{3}")
path_mapper_8 = PathMapper(_4_rooms.indices, source="{0}", target="{3}")
_5_rooms = CSharpScript(four_rms=_4_rooms.four_rms, four_ind=_4_rooms.indices, sel_index=sel_index_3, split_dim=split_dim_4, cut_pos=cut_pos_4)  # -> out, flatten(five_rms), flatten(indices); inputs four_rms: list of Box, four_ind: list of Int32, sel_index: Int32, split_dim: String, cut_pos: Double
# ---------- _5_rooms: C# ----------
    double x_max = four_rms[0].X.Max;
    double y_max = four_rms[0].Y.Max;
    for (int i = 1; i < four_rms.Count; i++){
      if (four_rms[i].X.Max > x_max){
        x_max = four_rms[i].X.Max;
      }
      if (four_rms[i].Y.Max > y_max){
        y_max = four_rms[i].Y.Max;
      }
    }

    Box sel_box = new Box();
    List <Box> box_list = new List<Box>();
    List <Int32> ind_list = new List<Int32>();
    for (int i = 0; i < four_rms.Count;i++){
      if (four_ind[i] != sel_index){
        box_list.Add(four_rms[i]);
        ind_list.Add(four_ind[i]);
      }
      else{
        sel_box = four_rms[i];
      }
    }
    double x_length = sel_box.X.Length;
    double y_length = sel_box.Y.Length;

    if (string.Equals(split_dim, "x")){
      double xlen_1 = Math.Round((x_length / 0.25) * cut_pos, 0) * 0.25;
      Interval x_1 = new Interval(sel_box.X.Min, sel_box.X.Min + xlen_1);
      Interval x_2 = new Interval(sel_box.X.Min + xlen_1, sel_box.X.Min + x_length);
      box_list.Add(new Box(Plane.WorldXY, x_1, sel_box.Y, sel_box.Z));
      ind_list.Add(sel_index);
      box_list.Add(new Box(Plane.WorldXY, x_2, sel_box.Y, sel_box.Z));
      ind_list.Add(4);
    }
    if (string.Equals(split_dim, "y")){
      double ylen_1 = Math.Round((y_length / 0.25) * cut_pos, 0) * 0.25;
      Interval y_1 = new Interval(sel_box.Y.Min, sel_box.Y.Min + ylen_1);
      Interval y_2 = new Interval(sel_box.Y.Min + ylen_1, sel_box.Y.Min + y_length);
      box_list.Add(new Box(Plane.WorldXY, sel_box.X, y_1, sel_box.Z));
      ind_list.Add(sel_index);
      box_list.Add(new Box(Plane.WorldXY, sel_box.X, y_2, sel_box.Z));
      ind_list.Add(4);
    }

    five_rms = box_list;
    indices = ind_list;
# ---------- end _5_rooms ----------
path_mapper_9 = PathMapper(_5_rooms.five_rms, source="{0}", target="{4}")
path_mapper_10 = PathMapper(_5_rooms.indices, source="{0}", target="{4}")
int_3 = Integer([path_mapper_2, path_mapper_6, path_mapper_3, path_mapper_8, path_mapper_10])
box = Box([path_mapper, path_mapper_4, path_mapper_5, path_mapper_7, path_mapper_9])
r_io = CSharpScript(step=int_2, id_i=int_3, rm_i=box)  # -> flatten(id_o), flatten(rm_o); inputs step: Int32, id_i: tree of Int32, rm_i: tree of Box
# ---------- r_io: C# ----------
    id_o = id_i.Branch(step);
    rm_o = rm_i.Branch(step);
# ---------- end r_io ----------
sort = SortList(Keys=r_io.id_o, ValuesA=r_io.rm_o)  # -> Keys, ValuesA
A = ClusterOutput(sort.ValuesA)

# ==== cluster Display_Geometry
box = ClusterInput()
recs = ClusterInput()
show = ClusterInput()
box_2 = Box(box)
python = GhPythonScript(recs=recs, show=show)  # -> rec_out; inputs recs: list of Rectangle3d, show: Boolean
# ---------- python: Python ----------
__author__ = "Xiaoshi"
__version__ = "2023.04.13"

import rhinoscriptsyntax as rs

if show:
    rec_out = recs
else:
    rec_out = []
# ---------- end python ----------
boundary = BoundarySurfaces(Edges=python)
c_script = CSharpScript(boxes=box_2)  # -> all_rec; inputs boxes: list of Brep
# ---------- c_script: C# ----------
    //List<Surface> surfs = new List<Surface>();
    Brep[] bbrep = Brep.CreateBooleanUnion(boxes.ToArray(), 0.0001);
    Curve[] Ei = bbrep[0].DuplicateEdgeCurves();
    List<Rectangle3d> surfs = new List<Rectangle3d>();
    for (int i = 0; i < Ei.Length; i++){
      if (Ei[i].PointAt(0.5).Z == 0.0){
        Line li = new Line(Ei[i].PointAtStart, Ei[i].PointAtEnd);
        if (li.FromX == li.ToX){
          Point3d pt_ori = new Point3d(li.FromX, (li.FromY + li.ToY) / 2.0, 1.5);
          Plane pl = new Plane(pt_ori, Vector3d.YAxis, Vector3d.ZAxis);
          Rectangle3d rec = new Rectangle3d(pl, new Interval(-li.Length / 2.0, li.Length / 2.0), new Interval(-1.5, 1.5));
          surfs.Add(rec);
        }
        else{
          Point3d pt_ori = new Point3d((li.FromX + li.ToX) / 2.0, li.FromY, 1.5);
          Plane pl = new Plane(pt_ori, Vector3d.XAxis, Vector3d.ZAxis);
          Rectangle3d rec = new Rectangle3d(pl, new Interval(-li.Length / 2.0, li.Length / 2.0), new Interval(-1.5, 1.5));
          surfs.Add(rec);
        }
      }
    }
    all_rec = surfs;
# ---------- end c_script ----------
sel_id = ClusterInput()
flip = Flip(Surface=boundary)  # -> Surface, Result
debrep = DeconstructBrep(Brep=box_2)  # -> simplify(Faces), Edges, Vertices
tag_dim = CSharpScript(rms=box_2)  # -> flatten(dim_lines), anchors; inputs rms: list of Box
# ---------- tag_dim: C# ----------
    List<Line> line_list = new List<Line>();
    List<Point3d> pts = new List<Point3d>();
    double x_max = rms[0].X.Max;
    double y_max = rms[0].Y.Max;
    for (int i = 1; i < rms.Count; i++){
      if (rms[i].X.Max > x_max){
        x_max = rms[i].X.Max;
      }
      if (rms[i].Y.Max > y_max){
        y_max = rms[i].Y.Max;
      }
    }
    Rectangle3d bnd = new Rectangle3d(Plane.WorldXY, new Point3d(-0.09, -0.09, 0.0), new Point3d(x_max + 0.09, y_max + 0.09, 0.0));
    for (int i = 0; i < rms.Count; i++){
      double xl = rms[i].X.Min;
      double xh = rms[i].X.Max;
      double yl = rms[i].Y.Min;
      double yh = rms[i].Y.Max;
      Line line_1 = new Line(xl - 1.0, yl, 0.0, xl - 1.0, yh, 0.0);
      if (bnd.Contains(line_1.PointAt(0.5)) == Rhino.Geometry.PointContainment.Outside){
        line_list.Add(line_1);
      }
      Line line_2 = new Line(xl, yl - 1.0, 0.0, xh, yl - 1.0, 0.0);
      if (bnd.Contains(line_2.PointAt(0.5)) == Rhino.Geometry.PointContainment.Outside){
        line_list.Add(line_2);
      }
      Line line_3 = new Line(xh + 1.0, yl, 0.0, xh + 1.0, yh, 0.0);
      if (bnd.Contains(line_3.PointAt(0.5)) == Rhino.Geometry.PointContainment.Outside){
        line_list.Add(line_3);
      }
      Line line_4 = new Line(xl, yh + 1.0, 0.0, xh, yh + 1.0, 0.0);
      if (bnd.Contains(line_4.PointAt(0.5)) == Rhino.Geometry.PointContainment.Outside){
        line_list.Add(line_4);
      }
    }

    for (int i = 0; i < rms.Count; i++){
      Point3d pt = new Point3d(rms[i].Center.X, rms[i].Center.Y, rms[i].Center.Z + rms[i].Z.Length / 2.0 - 1.0);
      pts.Add(pt);
    }

    dim_lines = line_list;
    anchors = pts;
# ---------- end tag_dim ----------
tag_info = CSharpScript(faces=c_script, win_fs=python, sel_id=sel_id)  # -> out, sel_anchors, sel_tags, unsel_anchors, unsel_tags; inputs faces: list of Rectangle3d, win_fs: list of Rectangle3d, sel_id: list of Int32
# ---------- tag_info: C# ----------
    List<Point3d> sel_pts = new List<Point3d>();
    List<Point3d> unsel_pts = new List<Point3d>();
    List<int> ind_1 = new List<int>();
    List<int> ind_2 = new List<int>();
    if (win_fs.Count > 0){
      for (int i = 0; i < faces.Count; i++){
        if (sel_id.Contains(i)){
          sel_pts.Add(win_fs[sel_id.IndexOf(i)].PointAt(0.5, 0.5));
          ind_1.Add(i);
        }
        else{
          unsel_pts.Add(faces[i].PointAt(0.5, 0.5));
          ind_2.Add(i);
        }
      }
    }
    sel_anchors = sel_pts;
    unsel_anchors = unsel_pts;
    sel_tags = ind_1;
    unsel_tags = ind_2;
# ---------- end tag_info ----------
srf = Surface([boundary, flip.Surface])
c_script_2 = CSharpScript(walls=debrep.Faces, wins=srf)  # -> simplify(A); inputs walls: tree of Brep, wins: list of Brep
# ---------- c_script_2: C# ----------
    DataTree<Brep> new_walls = walls;
    int num_room = walls.BranchCount;
    Brep[] new_wall;

    for(int i = 0; i < wins.Count; i++){
      for(int j = 0; j < num_room; j++){
        for(int k = 0; k < new_walls.Branch(j).Count; k++){
          Vector3d wa = new_walls.Branch(j)[k].Faces[0].NormalAt(0.0, 0.0);
          Vector3d wi = wins[i].Faces[0].NormalAt(0.0, 0.0);
          if(wa.IsParallelTo(wi) == 1){
            new_wall = Brep.CreateBooleanDifference(new_walls.Branch(j)[k], wins[i], 0.001);
            if(new_wall == null){
              break;
            }
            if(new_wall.Length > 0){
              new_walls.Branch(j).RemoveAt(k);
              for(int m = 0; m < new_wall.Length; m++){
                new_walls.Branch(j).Add(new_wall[m]);
              }
              break;
            }
          }
        }
      }
    }
    A = new_walls;
# ---------- end c_script_2 ----------
tag = TextTag(Location=tag_info.sel_anchors, Text=tag_info.sel_tags, Colour=RGB(255, 255, 255))
symsim = SymbolSimple(Style=1, Size=15, Rotation=0, Colour=RGB(255, 255, 255))
hide_roof = ClusterInput()
tag_2 = TextTag(Location=tag_info.unsel_anchors, Text=tag_info.unsel_tags, Colour=RGBA(153, 153, 153, 115))
symbol = SymbolDisplay(Location=tag_info.sel_anchors, Display=symsim)
c_script_3 = CSharpScript(surf_tree=c_script_2, hide_roof=hide_roof)  # -> surfs, fl_sfs; inputs surf_tree: tree of Brep, hide_roof: Boolean
# ---------- c_script_3: C# ----------
    DataTree < Brep > new_surf = new DataTree<Brep>();
    DataTree < Brep > fl_surf = new DataTree<Brep>();

    if (hide_roof){
      //new_surf.Clear();
      int num_room = surf_tree.BranchCount;
      for(int i = 0; i < num_room; i++){
        //List<Brep> branch_i = new List<Brep>();
        for(int j = 0; j < surf_tree.Branch(i).Count; j++){
          Brep surf = surf_tree.Branch(i)[j];
          double cen_z = surf.GetBoundingBox(true).Center.Z;
          if ((cen_z < 2.95) && (cen_z > 0.05)){
            new_surf.Add(surf, new GH_Path(i));
          }
          else if (cen_z < 0.05){
            fl_surf.Add(surf, new GH_Path(i));
          }
        }
      }
    }
    else{
      new_surf = surf_tree;
    }

    surfs = new_surf;
    fl_sfs = fl_surf;
# ---------- end c_script_3 ----------
join = BrepJoin(Breps=c_script_3.surfs)  # -> flatten(Breps), Closed
join_2 = BrepJoin(Breps=c_script_3.fl_sfs)  # -> flatten(Breps), Closed
lng = ListLength(List=box_2)

preview = CustomPreview(Geometry=join.Breps, Material=ColourSwatch(SwatchColor=RGB(46, 46, 46)))

preview_2 = CustomPreview(Geometry=join_2.Breps, Material=ColourSwatch(SwatchColor=RGBA(31, 31, 31, 118)))

preview_3 = CustomPreview(Geometry=python, Material=ColourSwatch(SwatchColor=RGB(255, 255, 255)))

symsim_2 = SymbolSimple(Style=5, Size=20, Rotation=0, Colour=RGB(255, 255, 51))
series = Series(Start=0, Step=1, Count=lng)  # -> flatten(Series)
tag_3 = TextTag(Location=tag_dim.anchors, Text=series, Colour=RGB(0, 0, 0))
linedim = LineDimension(Line=tag_dim.dim_lines, Text="{0:0.00}", Size=0.3)
symbol_2 = SymbolDisplay(Location=tag_dim.anchors, Display=symsim_2)

# ==== cluster Display_Airflow_Field
folder = ClusterInput()
ext_xdim = ClusterInput()
ext_ydim = ClusterInput()
elevation = ClusterInput()
uvwp = ClusterInput()
python = GhPythonScript(folder=folder, ext_xdim=ext_xdim, ext_ydim=ext_ydim, elevation=elevation, uvwp=uvwp)  # -> lgd_st_pt, start_pt, path
# ---------- python: Python ----------
__author__ = "Xiaoshi"
__version__ = "2023.02.04"

import rhinoscriptsyntax as rs
import Rhino.Geometry as rg
import csv

res = 0.25
#gh_file_path = ghenv.Component.OnPingDocument().FilePath
#folder = gh_file_path.replace("OILR_GH_Tooling_0410.gh","")
path = folder + "Result_uvwp/"+uvwp+"_" + str(int(elevation/res)) + ".csv"
x_start = 0.0 - round((128-ext_xdim/res)/3.0)*res
y_start = 0.0 - round((128-ext_ydim/res)/2.0)*res + res
z_start = elevation + res/2.0
start_pt = rg.Point3d(x_start, y_start, z_start)
lgd_st_pt = rg.Point3d(x_start + 32 + 4, y_start, z_start)
# ---------- end python ----------
file = ReadFile(File=python.path, PerLineParse=True)
split = TextSplit(Text=file, Separators=",")  # -> simplify(Result)
recgrid = Rectangular(Plane=python.lgd_st_pt, SizeX=2, SizeY=2, ExtentX=1, ExtentY=16)  # -> flatten(Cells), Points
sqgrid = Square(Plane=python.start_pt, Size="0.25", ExtentX="128", ExtentY="128")  # -> Cells, Points
num = Number(split)
python_2 = GhPythonScript(low_sc=Slider(0.6, range=0..1), up_sc=Slider(1, range=0..1), data=flatten(num))  # -> low_bnd, up_bnd; inputs data: list
# ---------- python_2: Python ----------
__author__ = "Xiaoshi"
__version__ = "2023.02.04"

import rhinoscriptsyntax as rs
import Rhino.Geometry as rg
import ghpythonlib.treehelpers as gt
import csv

res = 0.25
up_bnd = max(data)*up_sc
low_bnd = min(data)*low_sc
# ---------- end python_2 ----------
mesh = Mesh(flatten(sqgrid.Cells))
panel = Panel(python_2.low_bnd)
panel_2 = Panel(python_2.up_bnd)
dom = ConstructDomain(DomainStart=panel, DomainEnd=panel_2)
gradient = Gradient(
    LowerLimit=panel,
    UpperLimit=panel_2,
    Parameter=num,
    stops=[0: RGB(75, 107, 169), 0.254: RGB(173, 203, 249), 0.5: RGB(254, 244, 84), 0.751: RGB(234, 126, 0), 1: RGB(234, 38, 0)])
c_script = CSharpScript(cells=recgrid.Cells)  # -> pts; inputs cells: list of Polyline
# ---------- c_script: C# ----------
    List<Point3d> new_pts = new List<Point3d>();
    Vector3d vec = new Vector3d(3, 0, 0);
    Transform xform = Transform.Translation(vec);
    for (int i = 0; i < cells.Count; i++){
      Point3d pt = cells[i].CenterPoint();
      pt.Transform(xform);
      new_pts.Add(pt);
    }
    pts = new_pts;
# ---------- end c_script ----------
range = Range(Domain=dom, Steps=15)
python_3 = GhPythonScript(x=range)  # -> a; inputs x: list
# ---------- python_3: Python ----------
__author__ = "Xiaoshi"
__version__ = "2023.02.11"

import rhinoscriptsyntax as rs
a = [round(i, 2) for i in x]
# ---------- end python_3 ----------
gradient_2 = Gradient(
    LowerLimit=panel,
    UpperLimit=panel_2,
    Parameter=range,
    stops=[0: RGB(75, 107, 169), 0.254: RGB(173, 203, 249), 0.5: RGB(254, 244, 84), 0.751: RGB(234, 126, 0), 1: RGB(234, 38, 0)])
transparency = Slider(0.8, range=0.1..1)
col = Colour(flatten(gradient))
argb = SplitARGB(Colour=col)  # -> Alpha, Red, Green, Blue
frgb = ColourRGBF(Alpha=transparency, Red=argb.Red, Green=argb.Green, Blue=argb.Blue)
col_2 = Colour(flatten(gradient_2))
argb_2 = SplitARGB(Colour=col_2)  # -> Alpha, Red, Green, Blue
frgb_2 = ColourRGBF(Alpha=transparency, Red=argb_2.Red, Green=argb_2.Green, Blue=argb_2.Blue)
mcol = MeshColours(Mesh=graft(mesh), Colours=graft(frgb))  # -> flatten(Mesh)
mcol_2 = MeshColours(Mesh=graft(recgrid.Cells), Colours=graft(frgb_2))  # -> flatten(Mesh)
mjoin = MeshJoin(Meshes=mcol_2)
mjoin_2 = MeshJoin(Meshes=mcol)
tag = TextTag(Location=c_script, Text=python_3, Colour=RGB(0, 0, 0))
mesh_2 = Mesh(mjoin)
mesh_3 = Mesh(mjoin_2)
